# Grasshopper definition L3-3DPSlicerGcodeGenerator with Extra Credit.gh (Grasshopper 1.0.8)
# plug-ins: PTComponentLibrary, Pancake

# [TODO]: Create Test Cylinder and Move to center of Bed
location = Slider(105, range=0..105)
construct_point = ConstructPoint(XCoordinate=location, YCoordinate=location, ZCoordinate=0)
num_layers = Slider(6, range=0..10)
height = Slider(0.3, range=0..10)
radius = Slider(10, range=0..10)
xy_plane = XYPlane(Origin=construct_point)
height_2 = Multiplication(A=height, B=num_layers)
# [TODO]: Create Contours / Perimeters)
cylinder = Cylinder(Base=xy_plane, Radius=radius, Length=height_2)
unit_z = UnitZ(Factor=1)
cap_holes = CapHoles(Brep=cylinder)
contour = Contour(Shape=cap_holes, Point=Point(0, 0, 0), Direction=unit_z, Distance=height)
# [TODO]: Create Infill Patterns
split_list = SplitList(List=flatten(contour), Index="1")  # -> Layer0GettingRidOf, KeepLayers
percent_infill = Slider(100, range=0..100)
nozzle_diameter = Panel(".4")
unit_x = UnitX(Factor=1)
panel = Panel(split_list.Layer0GettingRidOf)
extrusion_width = Multiplication(A=nozzle_diameter, B="1.2")
division = Division(A="100", B=percent_infill)
# [TODO]: Combine Perimeters and Infill
panel_2 = Panel(contour)
multiplication = Multiplication(A=extrusion_width, B=division)
simplify_tree = SimplifyTree(Tree=split_list.KeepLayers, Front=False)
contour_2 = Contour(Shape=simplify_tree, Point=Point(0, 0, 0), Direction=unit_x, Distance=multiplication)
panel_3 = Panel(split_list.KeepLayers)
trim_tree = TrimTree(Tree=simplify_tree, Depth=1)
param_viewer = ParamViewer(contour_2)
trim_tree_2 = TrimTree(Tree=contour_2, Depth=Slider(2, range=0..2))
panel_4 = Panel(trim_tree_2)
graft_tree = GraftTree(Tree=trim_tree, IncludeEmptyLists=True, IncludeNullItems=True)
# [TODO]: Create Line Segments from Perimeters and Infill
panel_5 = Panel(trim_tree)
graft_tree_2 = GraftTree(Tree=trim_tree_2, IncludeEmptyLists=True, IncludeNullItems=True)
simplify_tree_2 = SimplifyTree(Tree=graft_tree, Front=False)
panel_6 = Panel(simplify_tree_2)
param_viewer_2 = ParamViewer(contour_2)
simplify_tree_3 = SimplifyTree(Tree=graft_tree_2, Front=False)
merge = Merge(Data1=simplify_tree_2, Data2=simplify_tree_3)
param_viewer_3 = ParamViewer(graft_tree)
panel_7 = Panel(merge)
divide_distance = DivideDistance(Curve=merge, Distance=Slider(0.1, range=0..0.1), AddEnd=Toggle(True))
polyline = PolyLine(Vertices=divide_distance, Closed=False)
panel_8 = Panel(divide_distance)
simplify_curve = SimplifyCurve(Curve=polyline, Tolerance=Slider(0.01, range=0..0.01))  # -> Curve, Simplified
panel_9 = Panel(simplify_curve.Curve)
explode = Explode(Curve=simplify_curve.Curve, Recursive=True)  # -> Segments, Vertices
line = Line(explode.Segments)
panel_10 = Panel(explode.Segments)
panel_11 = Panel(line)

# ---- group: A second line for testing
construct_point_2 = ConstructPoint(XCoordinate=Slider(10, range=-10..30), YCoordinate=Slider(10, range=-10..30), ZCoordinate=Slider(1, range=-10..30))
construct_point_3 = ConstructPoint(XCoordinate=Slider(10, range=-10..30), YCoordinate=Slider(20, range=-10..30), ZCoordinate=Slider(1, range=-10..30))
line_2 = Line(StartPoint=construct_point_2, EndPoint=construct_point_3)

# ---- group: Example of a line for testing
# [TODO]: Use lines for testing gcode generation then replace with line segments from slicing
number_slider = Slider(5, range=-10..30)
construct_point_4 = ConstructPoint(XCoordinate=number_slider, YCoordinate=Slider(1, range=-10..30), ZCoordinate=Slider(0, range=-10..30))
construct_point_5 = ConstructPoint(XCoordinate=Slider(30, range=-10..30), YCoordinate=Slider(1, range=-10..30), ZCoordinate=Slider(0, range=-10..30))
line_3 = Line(StartPoint=construct_point_4, EndPoint=construct_point_5)

# ----
end_gcode_do_not_edit = Panel("""; ##### WARNING: DO NOT EDIT THE END GCODE! ######
; END Gcode 
M107
;TYPE:Custom
; Filament-specific end gcode
G1 Z2.4 F720 ; Move print head up
M104 S0 ; turn off temperature
M140 S0 ; turn off heatbed
M107 ; turn off fan
G1 X241 Y170 F3600 ; park
G1 Z24.4 F300 ; Move print head up
M73 P97 R0
M73 Q97 S0
G4 ; wait
M900 K0 ; reset LA
M142 S36 ; reset heatbreak target temp
M84 X Y E ; disable motors
M73 P100 R0
M73 Q100 S0""")
start_gcode_do_not_edit = Panel(""";#### WARNING: DO NOT EDIT THE START GCODE! #####
;START GCODE
M73 P0 R2
M73 Q0 S2
M201 X2500 Y2500 Z200 E2500 ; sets maximum accelerations, mm/sec^2
M203 X200 Y200 Z40 E100 ; sets maximum feedrates, mm / sec
M204 P2000 R1200 T2000 ; sets acceleration (P, T) and retract acceleration (R), mm/sec^2
M205 X8.00 Y8.00 Z2.00 E10.00 ; sets the jerk limits, mm/sec
M205 S0 T0 ; sets the minimum extruding and travel feed rate, mm/sec

M486 S0
M486 custom-gcode.stl
M486 S-1

;TYPE:Custom v20251022a
M17 ; enable steppers
M862.3 P "MK4" ; printer model check
M862.1 P0.4 A0 F0 ; nozzle check
M115 U6.1.3+7898
M555 X115 Y91 W32 H24

G90 ; use absolute coordinates
M83 ; extruder relative mode

M140 S60 ; set bed temp
M104 T0 S170 ; set extruder temp for bed leveling
M109 T0 R170 ; wait for temp

M84 E ; turn off E motor
G28 ; home all without mesh bed level
G1 X42 Y-4 Z5 F4800
M302 S160 ; lower cold extrusion limit to 160C
G1 E-2 F2400 ; retraction
M84 E ; turn off E motor
G29 P9 X10 Y-4 W32 H4
M106 S100
G0 Z40 F10000
M190 S60 ; wait for bed temp
M107
;
; MBL
;
M84 E ; turn off E motor
G29 P1 ; invalidate mbl & probe print area
G29 P1 X0 Y0 W50 H20 C ; probe near purge place
G29 P3.2 ; interpolate mbl probes
G29 P3.13 ; extrapolate mbl outside probe area
G29 A ; activate mbl

; prepare for purge
M104 S215
G0 X0 Y-4 Z15 F4800 ; move away and ready for the purge
M73 P1 R2
M73 Q1 S2
M109 S215

G92 E0
M569 S0 E ; set spreadcycle mode for extruder
;
; Extrude purge line
;
G92 E0 ; reset extruder position
G1 E2 F2400 ; deretraction after the initial one before nozzle cleaning
G0 E7 X15 Z0.2 F500 ; purge
G0 X25 E4 F500 ; purge
M73 P3 R2
M73 Q3 S2
G0 X35 E4 F650 ; purge
M73 P4 R2
M73 Q4 S2
G0 X45 E4 F800 ; purge
G0 X48 Z0.05 F8000 ; wipe, move close to the bed
M73 P5 R2
M73 Q5 S2
G0 X51 Z0.2 F8000 ; wipe, move quickly away from the bed

G92 E0
M221 S100 ; set flow to 100%
G21 ; set units to millimeters
G90 ; use absolute coordinates
M83 ; use relative distances for extrusion
M900 K0.05 ; Filament gcode

M142 S36 ; set heatbreak target temp
M107""")
travel_feed_rate = Panel("1200")
# [TODO]: Initialize Input Parameters
line_4 = Line(flatten(explode.Segments))
# NOTE THAT THIS GCODE OUTPUT ASSUMES:
# - A PRUSA MK4 as the Printer
# - PLA Material
# - Extrusion Temperature: 215C
# - Heated Bed Temperature: 60C
panel_12 = Panel("600")
panel_13 = Panel(line_4)
# [TODO]: Implement the gcode generation algorithm in Python
python_3_script_generate_gcode = Python3Script(
    lines=flatten(line_4),
    nozzle_diameter="0.4",
    filament_diameter="1.75",
    layer_height="0.3",
    extrusion_width="0.48",
    travel_feed_rate=travel_feed_rate,
    layer_change_feed_rate="720",
    extrusion_feed_rate=panel_12,
    start_gcode_lines=start_gcode_do_not_edit,
    end_gcode_lines=end_gcode_do_not_edit)  # -> out, gcode_output; inputs lines: list of Line, nozzle_diameter: Double, filament_diameter: Double, layer_height: Double, extrusion_width: Double, travel_feed_rate: Double, layer_change_feed_rate: Double, extrusion_feed_rate: Double, start_gcode_lines: list of String, end_gcode_lines: list of String
# ---------- python_3_script_generate_gcode: Python ----------
"""
    This file contains parameters, helpers, and setup to 
    create a basic gcode generation algorithm from line segments.
    
    The main 
    
    Inputs:
        lines: the line segments to be converted into gcode commands for extrusion 
        nozzle_diameter: the diameter of the 3D printer's nozzle
        filament_diameter: the diameter of the 3d printing filament
        layer_height: the height of each layer in the print
        extrusion_width: the width of the extruded line from the printer
        travel_feed_rate: the speed at which the extruder moves in X and Y
        layer_change_feed_rate: the speed at which teh extruder moves when 
            changing layers in the Z direction
        extrusion_feed_rate: the speed at which the extruder move when extruding

    Output:
        gcode_output: a string with gcode commands separate by new-lines"""

__author__ = "mrivera-cu"

import rhinoscriptsyntax as rs

import math


########## CONSTANTS BELOW ###############

# GCODE COMMANDS
COMMAND_MOVE = "G1"

# GCODE PARAM NAMES
PARAM_X = "X"
PARAM_Y = "Y"
PARAM_Z = "Z"
PARAM_E = "E"
PARAM_F = "F"

# Separates commands
COMMAND_DELIMITER = "\n"

# Precision for converting floats to strings
E_VALUE_PRECISION = 5
XYZ_VALUE_PRECISION = 3

# Float equality precision
FLOAT_EQUALITY_PRECISION = 5

# Converts a float (f) to a string with some precision of decimal places
# For example: 
# Input: f=0.1234, precision=3 
# Output: "0.123"
def float_to_string(f, precision=XYZ_VALUE_PRECISION): 
    f = float(f)
    str_format = "{value:." + str(precision) +"f}"
    return str_format.format(value=f)
    
# Helper to convert the E value to the proper precision
def e_value_to_string(e):
    return float_to_string(e, E_VALUE_PRECISION)

# Helper to convert the XYZ value to the proper precision
def xyz_value_to_string(e):
    return float_to_string(e, XYZ_VALUE_PRECISION)

#########################################################################

# Helper function to compare floats in grasshopper/python due to float precision errors
def are_floats_equal(f1, f2, epsilon=10**(-FLOAT_EQUALITY_PRECISION)):
    f1 *= 10**FLOAT_EQUALITY_PRECISION
    f2 *= 10**FLOAT_EQUALITY_PRECISION
    return math.fabs(f2 - f1) <= epsilon
    
# Helper function to compare if two points are equal (have the same coordinates)
# by handling float precision comparisons
def is_same_pt(ptA, ptB):
    return are_floats_equal(ptA[0], ptB[0]) and are_floats_equal(ptA[1], ptB[1]) and are_floats_equal(ptA[2], ptB[2])
     
def z_key(z):
    if float(layer_height) == 0.0:
        return float(z)
    index = int(round(float(z)/ float(layer_height)))
    return index * float(layer_height)

########################################################################
# creates a string consisting of a G1 move command and 
# any associated parameters
def gcode_move(current_pos, next_pos, feed_rate=None, should_extrude=False):
    # Start with "G1" as command
    move_command_str = COMMAND_MOVE
    
    # Compare X positions
    if (not are_floats_equal(current_pos[0],next_pos[0])):
        # we have a different x position so add it as a parameter to the command
        x_value = float_to_string(next_pos[0], precision=XYZ_VALUE_PRECISION)
        # Add X<x_value> to move string, e.g., X100.00
        move_command_str += " " + PARAM_X + x_value
    
    # Compare Y positions
    if (not are_floats_equal(current_pos[1], next_pos[1])):
        # we have a different y position so add the new position as a parameter
        y_value = float_to_string(next_pos[1], precision=XYZ_VALUE_PRECISION)
        # Add Y<y_value> to move string, e.g., Y100.00
        move_command_str += " " + PARAM_Y + y_value
    
    # Compare Z position
    if (not are_floats_equal(current_pos[2], next_pos[2])):
        # we have a different z position so add the new position as a parameter
        z_value = float_to_string(next_pos[2], precision=XYZ_VALUE_PRECISION)
        # Add Z<z_value> to move string, e.g., Z100.00
        move_command_str += " " + PARAM_Z + z_value
    
    # [TODO]: handle "should_extrude" == true by determining the proper amount to
    # extrude using the capsule model, then append the E parameter and value
    # to the move command.
    # NOTE: YOUR FLOAT PRECISION MUST MATCH E_VALUE_PRECISION
    if(should_extrude == True):
        Ldist = math.sqrt(((next_pos[0]-current_pos[0])**2)+ ((next_pos[1]-current_pos[1])**2)+ ((next_pos[2]-current_pos[2])**2))
        v_out = Ldist * ((layer_height * (extrusion_width - layer_height)) + ((math.pi * (layer_height/2)**2)))
        eVal = float_to_string(v_out / (math.pi*(filament_diameter/2.0)**2))
        move_command_str += " " + PARAM_E + eVal
    
    # See if we have a feedrate to use, and handle it differently than other 
    # parameters as it is an integer value
    if (feed_rate is not None):
        # feed rate is an int
        feed_rate_value = round(feed_rate)
        # Add F<feed_rate_value> to move string, e.g., F2000
        move_command_str += " " + PARAM_F + str(feed_rate_value)   
    
    # Remove excess whitespace on ends
    move_command_str = move_command_str.strip(" ")
    return move_command_str


############################################
############################################
############################################
    
''' Here's the main method of the script that uses the helper methods above '''

def generate_gcode():

    # [TODO]: Implement the algorithm to generate gcode for each layer by 
    # first to moveing to the layer height, then moving to each line segment.
    # Once at a line segment, you should move and extrude along it, 
    # then move (travel) to the next line until there are no lines left
    # For each of these movements, you should append the command to
    # the list: `all_move_commands`
    current_position = [0, 0, 0]        # start extruder at the origin
    all_move_commands = []              # list to hold for all the move commands
    #z sorting
    ordered =[]
    for ln in lines:
        z = z_key(ln.From[2])
        ordered.append((z,ln))
    ordered.sort(key=lambda t: t[0])
    
    for (_layerZ, line) in ordered:
        # Get pts of the line segment
        #line = lines[i]
        line_start_position = line.From
        line_end_position = line.To
        
        # [TODO]: Handle moving to the next layer (Z Position)
        # NOTE- ALL Z MOVEMENTS SHOULD:
        # 1) BE INDEPENDENT MOVES(e.g., G1 Z# and not move with other positions like XYE) 
        # 2) USE THE `layer_change_feedrate`
        # 3) BE IN INCREASING ORDER
        if(not are_floats_equal(line_start_position[2], current_position[2])):
            next_line = [current_position[0], current_position[1], line_start_position[2]]
            zMove = gcode_move(current_position, next_line, feed_rate = layer_change_feed_rate)
            all_move_commands.append(zMove)
            current_position[2] = line_start_position[2]

        # Now if our current_position is not the start of our line segment
        # we need to move (travel) to the line segment's starting point
        if not is_same_pt(current_position, line_start_position):
            # [Move to the the line_start_position
            move_to_line_start_command = gcode_move(current_position, line_start_position, feed_rate=travel_feed_rate)
            # A ppend command
            all_move_commands.append(move_to_line_start_command)
        
        # [TODO]: Once our extruder is at the start of the line, create a 
        # command to move AND extrude along 
        # the line segment using `extrusion_feed_rate`
        extruding = gcode_move(line_start_position, line_end_position, feed_rate = extrusion_feed_rate, should_extrude = True)

        # [TODO]: Append the move command across the line segment 
        all_move_commands.append(extruding)
        
        # [TODO]: Update the current position of our extruder to be at the end of the line
        current_position = [line_end_position[0], line_end_position[1], line_end_position[2]]
        
    # End of for-loop above -- now create the full set of commands


    # [TODO]: Once you have all of the move commands stored as a list in
    # `all_move_commands`, combine the `start_gcode_lines`, `all_move_commands`, and `end_gcode_lines`
    # into one list called `gcode_lines`   
    gcode_lines = start_gcode_lines + all_move_commands + end_gcode_lines

    # --- DO NOT EDIT BELOW ----
    # The takes the combined gcode_lines list and creates a string containing each line
    # separated by a COMMAND_DELIMITER (the new-line character), and sets it 
    # to the `gcode_output`variable of this component
    output = COMMAND_DELIMITER.join(gcode_lines)
    
    return output
    
''' RUN THE MAIN FUNCITON ABOVE - DO NOT EDIT '''
# this sets the gcode commands to be the the `gcode_output` variable of this grasshopper component
gcode_output = generate_gcode()
# ---------- end python_3_script_generate_gcode ----------
the_gcode_output = Panel(python_3_script_generate_gcode.gcode_output)
debugging_panel = Panel(python_3_script_generate_gcode.out)
# [TODO]: Use Pancake Plug-in to Export Gcode Output File as .gcode
panel_14 = Panel("C:\Users\helen\Downloads\slicer_out_five_layer.gcode")
true_only_button = TrueOnlyButton(LastSaveLocalization="neutral,N")
export_txt = ExportTXT(
    Content=the_gcode_output,
    FileLocation=panel_14,
    Overwrite=Toggle(True),
    Encoding="utf-8",
    Export=true_only_button,
    LastSaveLocalization="neutral,N")
panel_15 = Panel(export_txt)
